# Grasshopper definition GenerativeDesign01.gh (Grasshopper 1.0.7)

casenum = Slider(16, range=0..25)
seed = Slider(5, range=0..15)

# ---- group: Building Area
max = Slider(1, range=0..1)
min = Slider(0.37, range=0..1)

# ---- group: Park Overlay shadow Area
min_2 = Slider(0.08, range=0..1)
max_2 = Slider(0.52, range=0..1)

# ---- group: Neighbor Overshadow Area
max_3 = Slider(0.65, range=0..1)
min_3 = Slider(0, range=0..1)

# ----
floorunit = Panel("5")
# WRITTEN BY KYUNG-JIN CHO, 2021 FEB, STOCKHOLM, SWEDEN
# ORGANIZE GROUP
# PARAMETERS
# FloorUnit : 5
# random number : from 1 to (int) (110/floorUnit)
# generate 8 random numbers
# add the maxmum value in index number 4 (insert)
# FloorWidth : 23 meter
# FloorHeight : 4.5 meter
floorwidth = Panel("23")
height = Panel("4.5")
# TARGET GEOMETRY
c_script = CSharpScript(recDim=floorwidth, extentX="3", extentY="3")  # -> out, A; inputs recDim: Double, extentX: Int32, extentY: Int32
# ---------- c_script: C# ----------
Interval size = new Interval(0, recDim);
Vector3d zUnit = new Vector3d(0,0,1);
List<Rectangle3d> rectangles = new List<Rectangle3d>();

for(int j = 0 ; j < extentY ; j++){
    for(int i = 0 ; i < extentX ; i++){
        Point3d p = new Point3d(i*recDim, j*recDim, 0);
        Plane pl = new Plane(p, zUnit);
        Rectangle3d rec = new Rectangle3d(pl, size, size);
        rectangles.Add(rec);
    }
}
        
A = rectangles;
# ---------- end c_script ----------

# ---- group: GenerateRandomFloor
c_script_2 = CSharpScript(floorUnit=floorunit, seed=seed, branchMax=casenum)  # -> out, A; inputs floorUnit: Int32, seed: Int32, branchMax: Int32
# ---------- c_script_2: C# ----------
DataTree<int> myTree = new DataTree<int>();
Random rand = new Random(seed);
int maxRand = (int)(110/floorUnit);
for(int i = 0 ; i < branchMax ; i++){
    List<int> floorListTemp = new List<int>();
    int lastValue = 0; 
    GH_Path pth = new GH_Path(i);

    for(int j = 0 ; j < 8 ; j++){
        int floor = floorUnit * rand.Next(1, maxRand);
        myTree.Add(floor, pth);
        floorListTemp.Add(floor);
        if(j==4) lastValue = floor;
    }
    
    myTree.Add(lastValue, pth);
    int middleFloor = floorListTemp.Max();
    myTree.Insert(middleFloor, pth, 4);
    floorListTemp.Clear();

}

A = myTree;
# ---------- end c_script_2 ----------

# ----
multiplication = Multiplication(A=c_script_2.A, B=height)

# ---- group: Park
geometry = Geometry(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)

# ---- group: Neighbor
geometry_2 = Geometry(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)

# ---- group: CalculateAreaSum
# BAKE GEOMETRY
# IMPORTANT GEOMETRY
c_script_3 = CSharpScript(width=floorwidth, floorT=c_script_2.A)  # -> out, AreaSumT; inputs width: Int32, floorT: tree of Int32
# ---------- c_script_3: C# ----------
Func<int, int> square = x => x * x;
int unitArea = square(width);
DataTree<int> areaT = new DataTree<int>();
int i = 0;
foreach(GH_Path path in floorT.Paths){
    List<int> area = floorT.Branch(path).Select(x => x*unitArea).ToList();
    int aresum = area.Sum();
    areaT.Add(aresum, new GH_Path(i));
    i++;
}

AreaSumT = areaT;
# ---------- end c_script_3 ----------

# ----
unit_z = UnitZ(Factor=multiplication)

number_slider = Slider(4, range=0..15)

# ---- group: ConvertToMesh
box_rectangle = BoxRectangle(Rectangle=c_script.A, Height=unit_z)
mesh_box = MeshBox(Base=box_rectangle, XCount="1", YCount="1", ZCount="1")  # -> simplify(Mesh)

# ---- group: SunVector
pi = Pi(Factor=Slider(1.15, range=0..2))
pi_2 = Pi(Factor=Slider(0.58, range=0..1))
c_script_4 = CSharpScript(longitud=pi, latitud=pi_2)  # -> out, sunVec; inputs longitud: Double, latitud: Double
# ---------- c_script_4: C# ----------
Sphere globe = new Sphere(new Point3d(0,0,0), 1500);
Point3d p = globe.PointAt(longitud, latitud);
Vector3d sunLight = new Vector3d(p);
sunLight.Reverse();
sunVec = sunLight;
# ---------- end c_script_4 ----------

# ---- group: ShadowOutline
xy_plane = XYPlane(Origin=Point(0, 0, 0))
buildingmesh = Mesh(mesh_box)
sunvector = Vector(c_script_4.sunVec)
mesh_shadow = MeshShadow(Mesh=buildingmesh, Light=sunvector, Plane=xy_plane)
c_script_5 = CSharpScript(outlines=mesh_shadow)  # -> out, A; inputs outlines: tree of Curve
# ---------- c_script_5: C# ----------
UnionCrvByPath(outlines);
A = unionCrvTree;
# ---------- c_script_5: C# additional code ----------
static double tol = RhinoDoc.ActiveDoc.ModelAbsoluteTolerance;

public int GetPathHashSetCount<T>(DataTree<T> tree){
    HashSet<int> hs = new HashSet<int>();
    foreach(GH_Path path in tree.Paths){
        hs.Add(path.Indices[0]);
    }
    return hs.Count;
}

public DataTree<Curve> unionCrvTree;
public Curve[] resultCrv;

public void UnionCrvByPath(DataTree<Curve> crvTree){

    int pathCount = GetPathHashSetCount<Curve>(crvTree);
    unionCrvTree = new DataTree<Curve>();

    for(int i = 0 ; i < pathCount ; i++){

        List<GH_Path> paths = crvTree.Paths.Where(x=>x.Indices[0]==i).ToList();
        List<Curve> crvs = new List<Curve>();
        foreach(GH_Path path in paths){
            try{
                Curve crv = crvTree.Branch(path)[0];
                if(crv.IsClosed) crvs.Add(crv);
            }catch{
                Print("curve at : {0} is not a curve", path.ToString());
            }
        }

        if(crvs.Any()){
            resultCrv = Curve.CreateBooleanUnion(crvs, tol);
           if(resultCrv!=null){
           unionCrvTree.AddRange(resultCrv, new GH_Path(i));
           }else Print("curve cannot be union at :{0}", i);

        }
    }
}
# ---------- end c_script_5 ----------

# ---- group: Shadow Calculation
brep_plane = BrepPlane(Brep=geometry, Plane=PlaneXY(0, 0, 0))  # -> Curves, Points
brep_plane_2 = BrepPlane(Brep=geometry_2, Plane=PlaneXY(0, 0, 0))  # -> Curves, Points
shadowoutlines = Curve(c_script_5.A)
region_intersection = RegionIntersection(CurvesA=shadowoutlines, CurvesB=graft(brep_plane_2.Curves))
region_intersection_2 = RegionIntersection(CurvesA=shadowoutlines, CurvesB=graft(brep_plane.Curves))
c_script_6 = CSharpScript(crvTree=region_intersection)  # -> out, A; inputs crvTree: tree of Curve
# ---------- c_script_6: C# ----------
int area = 0;
int i = 0;
DataTree<int> areaT = new DataTree<int>();

foreach(GH_Path path in crvTree.Paths){
        if(crvTree.Branch(path).Any()){
            NurbsCurve crv = crvTree.Branch(path)[0].ToNurbsCurve();
            Brep[] brep = Brep.CreatePlanarBreps(crv, 0.01);
            area = (int)brep[0].GetArea();
            areaT.Add(area, new GH_Path(i));
            i++;
            }
        else{ 
            Print("DataTree is null at : {0}", path.ToString());
            }
    }

A = areaT;
# ---------- end c_script_6 ----------

# ---- group: Display Grid
c_script_7 = CSharpScript(dist=Slider(194, range=0..1000), extentX=number_slider, extentY=number_slider)  # -> out, A; inputs dist: Int32, extentX: Int32, extentY: Int32
# ---------- c_script_7: C# ----------
List<Point3d> pts = new List<Point3d>();

for(int j = 0 ; j < extentY ; j++){
    for(int i = 0 ; i < extentX ; i++){
        
    Point3d pt = new Point3d(i* dist, j* dist, 0);
    pts.Add(pt);
    
    }
}

A = pts;
# ---------- end c_script_7 ----------

# ---- group: Shadow Calculation / GetNullException
c_script_8 = CSharpScript(crvTree=region_intersection_2)  # -> out, A; inputs crvTree: tree of Curve; same code as c_script_6

# ----
point_list = PointList(Points=c_script_7.A, Size=30)  # disabled

# ---- group: BuildingAreaGraph
panel = Panel(" < ")

# ---- group: ParkShadowOverlayGraph
panel_2 = Panel(" < ")

# ---- group: NeighborShadowGraph
panel_3 = Panel(" < ")

# ---- group: Final Selection/display
initialdata = Integer(c_script_2.A)
height_2 = Panel("4.5")
floorwidth_2 = Panel("23")
point = Point(Point(1742.614089, 220.9433892, 0))
c_script_9 = CSharpScript(baseP=point, recDim=floorwidth_2, extentX="3", extentY="3")  # -> out, A; inputs baseP: Point3d, recDim: Double, extentX: Int32, extentY: Int32
# ---------- c_script_9: C# ----------
Interval size = new Interval(0, recDim);
Vector3d zUnit = new Vector3d(0,0,1);
List<Rectangle3d> rectangles = new List<Rectangle3d>();

for(int j = 0 ; j < extentY ; j++){
    for(int i = 0 ; i < extentX ; i++){
        Point3d p = new Point3d(baseP.X+i*recDim, baseP.Y+j*recDim, baseP.Z);
        Plane pl = new Plane(p, zUnit);
        Rectangle3d rec = new Rectangle3d(pl, size, size);
        rectangles.Add(rec);
    }
}

A = rectangles;
# ---------- end c_script_9 ----------

# ---- group: title display
unit_y = UnitY(Factor="-200")
move = Move(Geometry=point, Motion=unit_y)  # -> Geometry, Transform
text_tag_3d = TextTag3D(Location=move.Geometry, Text="           Final selection", Size=15, Justification=8)

# ---- group: BuildingAreaGraph
curve = Curve(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)

# ---- group: ParkShadowOverlayGraph
curve_2 = Curve(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)

# ---- group: NeighborShadowGraph
curve_3 = Curve(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)

# ---- group: Geometry Display
graft_tree = GraftTree(Tree=c_script_7.A, IncludeEmptyLists=True, IncludeNullItems=True)
shadowoutlines_2 = Curve(c_script_5.A)
parkareat = Integer(c_script_8.A)
neighborareat = Integer(c_script_6.A)
areasumtree = Integer(c_script_3.AreaSumT)
neighboroutline = Curve(brep_plane_2.Curves)
parkoutline = Curve(brep_plane.Curves)
unit_y_2 = UnitY(Factor="-90")
unit_y_3 = UnitY(Factor="-80")
unit_y_4 = UnitY(Factor="-100")

# ---- group: Geometry Display / SplitByMinimumBranch
c_script_10 = CSharpScript(
    meshT=mesh_box,
    gridT=graft_tree,
    shadowOutline=shadowoutlines_2,
    parkAreaT=parkareat,
    neighborAreaT=neighborareat,
    buildingAreaT=areasumtree)  # -> out, MeshT, GridT, ShadowT, ParkAreaT, NeighborAreaT, BuildingAreaT; inputs meshT: tree of Mesh, gridT: tree of Point3d, shadowOutline: tree of Curve, parkAreaT: tree of Int32, neighborAreaT: tree of Int32, buildingAreaT: tree of Int32
# ---------- c_script_10: C# ----------
int x = meshT.BranchCount;
int y = gridT.BranchCount;
int minCount = 0;

if(x>y) minCount = y;
else minCount = x;

meshT.SimplifyPaths();
gridT.SimplifyPaths();

DisplayMinT<Mesh>(meshT, minCount);
DisplayMinT<Point3d>(gridT, minCount);
DisplayMinT<Curve>(shadowOutline, minCount);
DisplayMinT<int>(parkAreaT, minCount);
DisplayMinT<int>(neighborAreaT, minCount);
DisplayMinT<int>(buildingAreaT, minCount);


MeshT = meshT;
GridT = gridT;
ShadowT = shadowOutline;
ParkAreaT = parkAreaT;
NeighborAreaT = neighborAreaT;
BuildingAreaT = buildingAreaT;
# ---------- c_script_10: C# additional code ----------
public void DisplayMinT<T>(DataTree<T> tree, int minCount){
    for(int i = tree.BranchCount ; i > minCount ; i--){
    GH_Path pth = new GH_Path(i-1);
    tree.RemovePath(pth);
    }
}
# ---------- end c_script_10 ----------

# ---- group: BuildingAreaGraph (continued)
buildingareat = Integer(c_script_10.BuildingAreaT)
c_script_11 = CSharpScript(graphCrv=curve, AreaT=buildingareat, AreaPtMin=min, AreaPtMax=max)  # -> out, AreaPtDisplay, IntervalMinMax, UserPtDisplayMin, UserPtMinText, UserPtDisplayMax, UserPtMaxText, PtsRange, PathAt; inputs graphCrv: Curve, AreaT: tree of Int32, AreaPtMin: Double, AreaPtMax: Double
# ---------- c_script_11: C# ----------
//duplicate DataTree to avoid manipulation
DataTree<int> dummyT = new DataTree<int>(AreaT);

setDomain(dummyT, graphCrv);

Point3d p1 = getUserPt(dummyT, graphCrv, AreaPtMin);
Point3d p2 = getUserPt(dummyT, graphCrv, AreaPtMax);

UserPtDisplayMin = p1;
UserPtMinText = (int)(dist*AreaPtMin + minAbs);
UserPtDisplayMax = p2;
UserPtMaxText = (int)(dist*AreaPtMax + minAbs);

getMinMax(p1, p2, dist, AreaPtMin, AreaPtMax);

IntervalMinMax = range;
AreaPtDisplay = ptL;

List<int> pathAtInt = GetPathInt(AreaT, userMin, userMax);
List<GH_Path> pathAt = GetPath(AreaT, userMin, userMax);
PathAt = pathAtInt;
PtsRange = GetPts(AreaT, pathAt, graphCrv);
# ---------- c_script_11: C# additional code ----------
public double dist;
public List<Point3d> ptL;
public double minAbs;
public Interval range;
public double userMin;
public double userMax;

public void setDomain(DataTree<int> tree, Curve crv){

    tree.Flatten();
    tree.SimplifyPaths();

    //set curve domain between min/max value
    crv.Domain = new Interval(tree.Branch(0).Min(), tree.Branch(0).Max());
    range = new Interval(tree.Branch(0).Min(), tree.Branch(0).Max());

    //declare public values
    minAbs = tree.Branch(0).Min();
    dist = tree.Branch(0).Max() - tree.Branch(0).Min();

    //display all value on curve
    ptL = new List<Point3d>();
    for(int i = 0 ; i < tree.Branch(0).Count ; i++){
        double val = tree.Branch(0)[i];
        ptL.Add(crv.PointAt(val));
    }

}

public Point3d getUserPt(DataTree<int> tree, Curve crv, double userPt){

    double userVal = dist*userPt + tree.Branch(0).Min();
    Point3d ptOnCrv = crv.PointAt(userVal);
    return ptOnCrv;

}

public void getMinMax(Point3d p1, Point3d p2, double dist, double AreaPtMin, double AreaPtMax){

    if(p1.Y > p2.Y) {
    userMax = minAbs + dist*AreaPtMin;
    userMin = minAbs + dist*AreaPtMax;
    }else if(p2.Y > p1.Y){
    userMax = minAbs + dist*AreaPtMax;
    userMin = minAbs + dist*AreaPtMin;
    }else{
        userMax = minAbs + dist*AreaPtMax;
        userMin = userMax;
    }
}

public List<GH_Path> GetPath(DataTree<int> tree, double min, double max){

    List<GH_Path> pathSelect = new List<GH_Path>();

    foreach(GH_Path path in tree.Paths){
        try{
            int val = tree.Branch(path)[0];
            if(val > min && val < max) pathSelect.Add(path);
            }
        catch{
            Print("the data is out of range at {0}", path.ToString());
            }

    }

 return pathSelect;

}


public List<int> GetPathInt(DataTree<int> tree, double min, double max){

    List<int> pathSelect = new List<int>();
    for(int i = 0 ; i < tree.Branches.Count ; i++){
        GH_Path path = new GH_Path(i);
        try{
            int val = tree.Branch(path)[0];
            if(val > min && val < max) pathSelect.Add(i);
            }
        catch{
            Print("the data is out of range at {0}", path.ToString());
            }

    }

 return pathSelect;

}

public List<Point3d> GetPts(DataTree<int> tree, List<GH_Path> paths, Curve graphCrv){

    List<Point3d> ptAt = new List<Point3d>();

    foreach(GH_Path path in paths){
        try{
            int val = tree.Branch(path)[0];
            Point3d p = graphCrv.PointAt(val);
            ptAt.Add(p);
            }catch{
            Print("The value at: {0} is not on the curve", path.ToString());
            }
        }

        return ptAt;
    }
# ---------- end c_script_11 ----------

# ---- group: NeighborShadowGraph (continued)
neighborareat_2 = Integer(c_script_10.NeighborAreaT)
c_script_12 = CSharpScript(graphCrv=curve_3, AreaT=neighborareat_2, AreaPtMin=min_3, AreaPtMax=max_3)  # -> out, AreaPtDisplay, IntervalMinMax, UserPtDisplayMin, UserPtMinText, UserPtDisplayMax, UserPtMaxText, PtsRange, PathAt; inputs graphCrv: Curve, AreaT: tree of Int32, AreaPtMin: Double, AreaPtMax: Double; same code as c_script_11

# ---- group: ParkShadowOverlayGraph (continued)
parkareat_2 = Integer(c_script_10.ParkAreaT)
c_script_13 = CSharpScript(graphCrv=curve_2, AreaT=parkareat_2, AreaPtMin=min_2, AreaPtMax=max_2)  # -> out, AreaPtDisplay, IntervalMinMax, UserPtDisplayMin, UserPtMinText, UserPtDisplayMax, UserPtMaxText, PtsRange, PathAt; inputs graphCrv: Curve, AreaT: tree of Int32, AreaPtMin: Double, AreaPtMax: Double; same code as c_script_11

# ---- group: Final Selection/display (continued)
neighborareapath = Integer(c_script_12.PathAt)
parkshadowpath = Integer(c_script_13.PathAt)
buildingareapath = Integer(c_script_11.PathAt)
c_script_14 = CSharpScript(List1=buildingareapath, List2=parkshadowpath, List3=neighborareapath, initialDataT=initialdata)  # -> out, CommonPathInt, CommonPathFloor; inputs List1: list of Int32, List2: list of Int32, List3: list of Int32, initialDataT: tree of Int32
# ---------- c_script_14: C# ----------
List<int> tempL = compareL(List1, List2);
List<int> resultL = compareL(tempL, List3);

if(resultL.Any()) CommonPathInt = resultL;
else Print("Cannot find common value");

DataTree<int> resultT = new DataTree<int>();
for(int i = 0 ; i < resultL.Count; i++){
    GH_Path path = new GH_Path(resultL[i]);
    GH_Path nyPath = new GH_Path(i);
    resultT.AddRange(initialDataT.Branch(path), nyPath);
}

CommonPathFloor = resultT;
# ---------- c_script_14: C# additional code ----------
public List<int> compareL(List<int> L1, List<int> L2){

    List<int> tempL = new List<int>();

    for(int i = 0 ; i <L1.Count ; i++){
        for(int j = 0 ; j < L2.Count; j++){
        if(L1[i]==L2[j]) tempL.Add(L2[j]);
        }
    }

    return tempL;
}
# ---------- end c_script_14 ----------
panel_4 = Panel(c_script_14.CommonPathInt)
panel_5 = Panel(c_script_14.CommonPathFloor)
multiplication_2 = Multiplication(A=c_script_14.CommonPathFloor, B=height_2)
unit_z_2 = UnitZ(Factor=multiplication_2)

# ---- group: Final Selection/display / ConvertToMesh
box_rectangle_2 = BoxRectangle(Rectangle=c_script_9.A, Height=unit_z_2)
mesh_box_2 = MeshBox(Base=box_rectangle_2, XCount="1", YCount="1", ZCount="1")  # -> simplify(Mesh)

# ---- group: ParkShadowOverlayGraph / MinMaxDisplay
deconstruct_domain = DeconstructDomain(Domain=c_script_13.IntervalMinMax)  # -> Start, End
end_points = EndPoints(Curve=curve_2)  # -> Start, End
text_tag_3d_2 = TextTag3D(Location=end_points.Start, Text=deconstruct_domain.Start, Size=15, Justification=3)
text_tag_3d_3 = TextTag3D(Location=end_points.End, Text=deconstruct_domain.End, Size=15, Justification=9)

# ---- group: BuildingAreaGraph / MinMaxDisplay
deconstruct_domain_2 = DeconstructDomain(Domain=c_script_11.IntervalMinMax)  # -> Start, End
end_points_2 = EndPoints(Curve=curve)  # -> Start, End
text_tag_3d_4 = TextTag3D(Location=end_points_2.Start, Text=deconstruct_domain_2.Start, Size=12, Justification=3)
text_tag_3d_5 = TextTag3D(Location=end_points_2.End, Text=deconstruct_domain_2.End, Size=12, Justification=9)

# ---- group: NeighborShadowGraph / MinMaxDisplay
deconstruct_domain_3 = DeconstructDomain(Domain=c_script_12.IntervalMinMax)  # -> Start, End
end_points_3 = EndPoints(Curve=curve_3)  # -> Start, End
text_tag_3d_6 = TextTag3D(Location=end_points_3.Start, Text=deconstruct_domain_3.Start, Size=15, Justification=3)
text_tag_3d_7 = TextTag3D(Location=end_points_3.End, Text=deconstruct_domain_3.End, Size=15, Justification=9)

# ---- group: ParkShadowOverlayGraph / MinPt
min_4 = Point(c_script_13.UserPtDisplayMin)

# ---- group: ParkShadowOverlayGraph
concatenate = Concatenate(FragmentA=panel_2, FragmentB=c_script_13.UserPtMinText)
text_tag_3d_8 = TextTag3D(Location=min_4, Text=concatenate, Size=10, Justification=4)

# ---- group: Geometry Display (continued)
move_2 = Move(Geometry=parkoutline, Motion=c_script_10.GridT)  # -> Geometry, Transform
move_3 = Move(Geometry=c_script_10.GridT, Motion=unit_y_3)  # -> Geometry, Transform
concatenate_2 = Concatenate(FragmentA="park over shadow area : ", FragmentB=c_script_10.ParkAreaT)
move_4 = Move(Geometry=c_script_10.GridT, Motion=unit_y_2)  # -> Geometry, Transform
concatenate_3 = Concatenate(FragmentA="neighborhood over shadow area : ", FragmentB=c_script_10.NeighborAreaT)
concatenate_4 = Concatenate(FragmentA="building area sum : ", FragmentB=c_script_10.BuildingAreaT)
move_5 = Move(Geometry=c_script_10.GridT, Motion=unit_y_4)  # -> Geometry, Transform

# ---- group: NeighborShadowGraph / MinPt
min_5 = Point(c_script_12.UserPtDisplayMin)

# ---- group: NeighborShadowGraph
concatenate_5 = Concatenate(FragmentA=panel_3, FragmentB=c_script_12.UserPtMinText)
text_tag_3d_9 = TextTag3D(Location=min_5, Text=concatenate_5, Size=10, Justification=4)

# ---- group: Geometry Display / surroundingOutline
move_6 = Move(Geometry=neighboroutline, Motion=c_script_10.GridT)  # -> Geometry, Transform

# ---- group: Geometry Display / Mesh
move_7 = Move(Geometry=c_script_10.MeshT, Motion=c_script_10.GridT)  # -> Geometry, Transform

# ---- group: Geometry Display / ShadowOutline
move_8 = Move(Geometry=c_script_10.ShadowT, Motion=c_script_10.GridT)  # -> Geometry, Transform

# ---- group: BuildingAreaGraph / MinPt
min_6 = Point(c_script_11.UserPtDisplayMin)

# ---- group: BuildingAreaGraph
concatenate_6 = Concatenate(FragmentA=panel, FragmentB=c_script_11.UserPtMinText)
text_tag_3d_10 = TextTag3D(Location=min_6, Text=concatenate_6, Size=10, Justification=4)

# ---- group: BuildingAreaGraph / MaxPt
point_2 = Point(c_script_11.UserPtDisplayMax)

# ---- group: BuildingAreaGraph
concatenate_7 = Concatenate(FragmentA=panel, FragmentB=c_script_11.UserPtMaxText)
text_tag_3d_11 = TextTag3D(Location=point_2, Text=concatenate_7, Size=10, Justification=4)

# ---- group: ParkShadowOverlayGraph / MaxPt
point_3 = Point(c_script_13.UserPtDisplayMax)

# ---- group: ParkShadowOverlayGraph
concatenate_8 = Concatenate(FragmentA=panel_2, FragmentB=c_script_13.UserPtMaxText)
text_tag_3d_12 = TextTag3D(Location=point_3, Text=concatenate_8, Size=10, Justification=4)

# ---- group: NeighborShadowGraph / MaxPt
point_4 = Point(c_script_12.UserPtDisplayMax)

# ---- group: NeighborShadowGraph
concatenate_9 = Concatenate(FragmentA=panel_3, FragmentB=c_script_12.UserPtMaxText)
text_tag_3d_13 = TextTag3D(Location=point_4, Text=concatenate_9, Size=10, Justification=4)

# ---- group: GraphLineDisplay
buildingareapt = Point(c_script_11.PtsRange)
neighborareapt = Point(c_script_12.PtsRange)
parkpt = Point(c_script_13.PtsRange)
line = Line(StartPoint=buildingareapt, EndPoint=parkpt)
line_2 = Line(StartPoint=parkpt, EndPoint=neighborareapt)

# ---- group: title display
unit_y_5 = UnitY(Factor="-70")
point_5 = Point(end_points_2.Start)
move_9 = Move(Geometry=point_5, Motion=unit_y_5)  # -> Geometry, Transform
text_tag_3d_14 = TextTag3D(Location=move_9.Geometry, Text="Building Area", Size=10, Justification=8)

unit_y_6 = UnitY(Factor="-70")
point_6 = Point(end_points.Start)
move_10 = Move(Geometry=point_6, Motion=unit_y_6)  # -> Geometry, Transform
text_tag_3d_15 = TextTag3D(Location=move_10.Geometry, Text="Park overshadow Area", Size=10, Justification=8)

unit_y_7 = UnitY(Factor="-70")
point_7 = Point(end_points_3.Start)
move_11 = Move(Geometry=point_7, Motion=unit_y_7)  # -> Geometry, Transform
text_tag_3d_16 = TextTag3D(Location=move_11.Geometry, Text="Neighbor overshadow Area", Size=10, Justification=8)

# ---- group: Geometry Display / ParkArea
text_tag_3d_17 = TextTag3D(Location=move_3.Geometry, Text=concatenate_2, Size=7, Justification=1)

# ---- group: Geometry Display / buildingAreaSum
text_tag_3d_18 = TextTag3D(Location=move_5.Geometry, Text=concatenate_4, Size=7, Justification=1)

# ---- group: Geometry Display / NeighborArea
text_tag_3d_19 = TextTag3D(Location=move_4.Geometry, Text=concatenate_3, Size=7, Justification=1)
